# Grasshopper definition topo_sole.gh (Grasshopper 1.0.8)
# plug-ins: tOpos, Weaverbird, Kangaroo2 Components

brep = Brep(<brep referenced from the Rhino model>)
point = Point(Point(4, -58, 0))
brep_2 = Brep(<brep referenced from the Rhino model>)
brep_3 = Brep(<brep referenced from the Rhino model>)
brep_4 = Brep(<brep referenced from the Rhino model>)
mesh = Mesh(brep_2)
# smoother mesh
mesh_2 = Mesh(<mesh referenced from the Rhino model>)
mesh_3 = Mesh(<mesh referenced from the Rhino model>)
negative = Negative(Value=Slider(1.6, range=0..5))
surface_load = SurfaceLoad(LoadSurface=brep_3, LoadValue=negative)
weaverbird_s_catmull_clark_subdivision = WeaverbirdsCatmullClarkSubdivision(MeshCurves=mesh_3, Level=Slider(0.89, range=0..1), SmoothNakedEdges=1)
deconstruct_mesh = DeconstructMesh(Mesh=mesh_2)  # -> Vertices, Faces, Colours, Normals
boundary_domain = BoundaryDomain(
    DomainMesh=mesh,
    DensityValue=Slider(7.85, range=0..10),
    YoungModul=Slider(200, range=0..500),
    PoissonNumber=Slider(0.33, range=0..1))
construct_mesh = ConstructMesh(Vertices=deconstruct_mesh.Vertices, Faces=deconstruct_mesh.Faces)
optimius_parameters = OptimiusParameters(
    OptimisationIteration=Slider(549, range=0..1000),
    VolumeFraction=Slider(0.18, range=0..1),
    Penalty=Domain(2, 3),
    Change=0.005,
    SensitivityFilterRadius=Domain(1.5, 1.5),
    DensityFilterType=0,
    GrayScaleFilter=False,
    HeavisideProjection=0,
    SensitivityFilterType=1)
boundary_conditions = BoundaryConditions(Load=surface_load, Support=brep_4)
analyser_parameters = AnalyserParameters(Iterations=Slider(48, range=1..100), Tolerance=0.001)
resolution = Resolution(Size=Slider(0.58, range=0..10), sizeModeToggle=True)
combine_clean = CombineClean(Meshes=construct_mesh)
smooth_mesh = SmoothMesh(Mesh=combine_clean, Strength=0.5, SkipNaked=True, Iterations=Slider(7, range=0..10))
model = Model(BoundaryDomain=boundary_domain, BoundaryCondition=boundary_conditions, ModelResolution=resolution, gpuModeToggle=False)  # -> Model, Performance
optimus = Optimus(
    Model=model.Model,
    AnalyserParameters=analyser_parameters,
    OptimusParameters=optimius_parameters,
    SubdivisionThreshold=0.5,
    Reset=Button(),
    Run=Toggle(False),
    optimisationPreviewMode=True,
    solverType=2)  # -> Model, Compliance, Performance
voxel_mesh = VoxelMesh(Model=optimus.Model, Threshold=Slider(0.6, range=0..1), asOneMeshMode=True, densityPreviewMode=True)
iso_mesh = IsoMesh(Model=optimus.Model, IsoValue=Slider(0.38, range=0..1), Deflection=0)
deconstruct_mesh_2 = DeconstructMesh(Mesh=iso_mesh)  # -> Vertices, Faces, Colours, Normals
construct_mesh_2 = ConstructMesh(Vertices=deconstruct_mesh_2.Vertices, Faces=deconstruct_mesh_2.Faces)
combine_clean_2 = CombineClean(Meshes=construct_mesh_2)
smooth_mesh_2 = SmoothMesh(Mesh=combine_clean_2, Strength=0.5, SkipNaked=True, Iterations=Slider(6, range=0..10))
